# Dynamo graph CollectBeamReferenceLevel_To_NewLevelParameter_script.dyn "CollectBeamReferenceLevel_To_NewLevelParameter" (Dynamo 2.12.1.8246)
# packages: Data-Shapes 2024.2.113

# group: Input
categories = Categories("OST_StructuralFraming")

code_block = CodeBlock { "Reference Level"; }

# group: Grab Geometry to Change Parameters in
all_elements_of_category = ElementsOfCategory(Category=categories)
boolean = BoolSelector(false)
clean = List.Clean(list=all_elements_of_category, preserveIndices=boolean)
flatten = List.Flatten(list=clean)
getParameterValueByName = Element.GetParameterValueByName(element=flatten, parameterName=code_block)

# group: Set Level Parameter - Output
code_block_2 = CodeBlock { "Level"; }
name = Level.Name(level=getParameterValueByName)
setParameterByName = Element.SetParameterByName(element=flatten, parameterName=code_block_2, value=name)
getParameterValueByName_2 = Element.GetParameterValueByName(element=setParameterByName, parameterName=code_block_2)

# group: Input: Categories
string = StringInput("Section 2: Select Revit Categories")
string_2 = StringInput("Select the Revit Categories")
categories_2 = Categories("OST_Floors")
categories_3 = Categories("OST_GenericModel")
categories_4 = Categories("OST_StructuralColumns")
categories_5 = Categories("OST_StructuralFoundation")
categories_6 = Categories("OST_StructuralFraming")
categories_7 = Categories("OST_Walls")
list_create = List.Create(item0=categories_2, item1=categories_3, item2=categories_4, item3=categories_5, item4=categories_6, item5=categories_7)
all_elements_of_category_2 = ElementsOfCategory(Category=list_create)
listview_data = Custom[Listview Data](InputName=string_2, Keys=list_create, Values=all_elements_of_category_2)  # package Data-Shapes; Create data for ListView input in UI.MultiInputForm ++ . Check out www.data-shapes.net for more infos.
list_create_2 = List.Create(item0=listview_data)
inputgroup_data = Custom[InputGroup Data](GroupTitle=string, Inputs=list_create_2)  # package Data-Shapes; Creates a group of inputs for UI.MultipleInputForm ++ . Check out www.data-shapes.net for more infos !
list_create_3 = List.Create(item0=inputgroup_data)

# group: Master UI
string_3 = StringInput("Quick update the Power BI Data")
file_path = Filename(".\icon.PNG")
file_from_path = FileObject(path=file_path)
readFromFile = Image.ReadFromFile(file=file_from_path)
string_4 = StringInput("Click here to continue")
boolean_2 = BoolSelector(true)
string_5 = StringInput("Cancel")
steel_density_in_kg_m3 = CodeBlock { 1200; 400; }
multipleinputform = Custom[MultipleInputForm ++](Description_optional=string_3, Logo_optional=readFromFile, ButtonText_optional=string_4, Inputs=list_create_3, Toggle=boolean_2, CancelButtonText_optional=string_5, MaxHeight_optional=steel_density_in_kg_m3.out0, Width_optional=steel_density_in_kg_m3.out0, LabelWidth_optional=steel_density_in_kg_m3.out1)  # frozen; package Data-Shapes; Create a form with multiple inputs. see www.data-shapes.net for tutorials and infos!
watch = Watch(multipleinputform.User_Inputs)
code_block_3 = CodeBlock { 0; 1; 2; 3; 4; 5; 6; 7; 8; 9; 10; 11; 12; 13; }

spreadsheet_file_path = List.GetItemAtIndex(list=watch, index=code_block_3.out0)
getItemAtIndex = List.GetItemAtIndex(list=spreadsheet_file_path, index=code_block_3.out0)
getItemAtIndex_2 = List.GetItemAtIndex(list=spreadsheet_file_path, index=code_block_3.out1)
getItemAtIndex_3 = List.GetItemAtIndex(list=spreadsheet_file_path, index=code_block_3.out2)
getItemAtIndex_4 = List.GetItemAtIndex(list=spreadsheet_file_path, index=code_block_3.out3)
getItemAtIndex_5 = List.GetItemAtIndex(list=spreadsheet_file_path, index=code_block_3.out4)
getItemAtIndex_6 = List.GetItemAtIndex(list=spreadsheet_file_path, index=code_block_3.out5)
list_create_4 = List.Create(item0=getItemAtIndex, item1=getItemAtIndex_2, item2=getItemAtIndex_3, item3=getItemAtIndex_4, item4=getItemAtIndex_5, item5=getItemAtIndex_6)
