# Dynamo graph CollectElementID_To_NewParameter_script.dyn (Dynamo 2.16.2.5624)
# packages: spring nodes 210.1.1, Data-Shapes 2024.2.113

categories = Categories("OST_StructuralFraming")

# group: Input: Categories
string = StringInput("Section 2: Select Revit Categories")
string_2 = StringInput("Select the Revit Categories")
categories_2 = Categories("OST_Floors")
categories_3 = Categories("OST_GenericModel")
categories_4 = Categories("OST_StructuralColumns")
categories_5 = Categories("OST_StructuralFoundation")
categories_6 = Categories("OST_StructuralFraming")
categories_7 = Categories("OST_Walls")
list_create = List.Create(item0=categories_2, item1=categories_3, item2=categories_4, item3=categories_5, item4=categories_6, item5=categories_7)
all_elements_of_category = ElementsOfCategory(Category=list_create)
listview_data = Custom[Listview Data](InputName=string_2, Keys=list_create, Values=all_elements_of_category)  # package Data-Shapes; Create data for ListView input in UI.MultiInputForm ++ . Check out www.data-shapes.net for more infos.
list_create_2 = List.Create(item0=listview_data)
inputgroup_data = Custom[InputGroup Data](GroupTitle=string, Inputs=list_create_2)  # package Data-Shapes; Creates a group of inputs for UI.MultipleInputForm ++ . Check out www.data-shapes.net for more infos !
list_create_3 = List.Create(item0=inputgroup_data)

# group: Master UI
string_3 = StringInput("Quick update the Power BI Data")
file_path = Filename("Script_to_pyRevit\AllanCantos.extension\AllanCantos.tab\To Asset ID.Panel\Update Asset ID.pushbutton\icon.PNG")
file_from_path = FileObject(path=file_path)
readFromFile = Image.ReadFromFile(file=file_from_path)
string_4 = StringInput("Click here to continue")
boolean = BoolSelector(true)
string_5 = StringInput("Cancel")
steel_density_in_kg_m3 = CodeBlock { 1200; 400; }
multipleinputform = Custom[MultipleInputForm ++](Description_optional=string_3, Logo_optional=readFromFile, ButtonText_optional=string_4, Inputs=list_create_3, Toggle=boolean, CancelButtonText_optional=string_5, MaxHeight_optional=steel_density_in_kg_m3.out0, Width_optional=steel_density_in_kg_m3.out0, LabelWidth_optional=steel_density_in_kg_m3.out1)  # package Data-Shapes; Create a form with multiple inputs. see www.data-shapes.net for tutorials and infos!
watch = Watch(multipleinputform.User_Inputs)
code_block = CodeBlock { 0; 1; 2; 3; 4; 5; 6; 7; 8; 9; 10; 11; 12; 13; }

spreadsheet_file_path = List.GetItemAtIndex(list=watch, index=code_block.out0)
getItemAtIndex = List.GetItemAtIndex(list=spreadsheet_file_path, index=code_block.out0)
getItemAtIndex_2 = List.GetItemAtIndex(list=spreadsheet_file_path, index=code_block.out1)
getItemAtIndex_3 = List.GetItemAtIndex(list=spreadsheet_file_path, index=code_block.out2)
getItemAtIndex_4 = List.GetItemAtIndex(list=spreadsheet_file_path, index=code_block.out3)
getItemAtIndex_5 = List.GetItemAtIndex(list=spreadsheet_file_path, index=code_block.out4)
getItemAtIndex_6 = List.GetItemAtIndex(list=spreadsheet_file_path, index=code_block.out5)
list_create_4 = List.Create(item0=getItemAtIndex, item1=getItemAtIndex_2, item2=getItemAtIndex_3, item3=getItemAtIndex_4, item4=getItemAtIndex_5, item5=getItemAtIndex_6)

# group: Collect Revit IDs
all_elements_of_category_2 = ElementsOfCategory(Category=categories)
boolean_2 = BoolSelector(false)
clean = List.Clean(list=list_create_4, preserveIndices=boolean_2)
flatten = List.Flatten(list=clean)
code_block_2 = CodeBlock(p=flatten) { p.Id; }
watch_2 = Watch(code_block_2)
# note: Springs Node
ꟿ_number_tostring = Custom[ꟿ Number.ToString](num=code_block_2)  # package spring nodes; Converts the input number(s) to string. You can optionally limit the number of digits.

# group: Output
code_block_3 = CodeBlock { "Asset_General_Identity_Revit_ID"; }
setParameterByName = Element.SetParameterByName(element=flatten, parameterName=code_block_3, value=ꟿ_number_tostring)
getParameterValueByName = Element.GetParameterValueByName(element=setParameterByName, parameterName=code_block_3)
watch_3 = Watch(getParameterValueByName)
