# Dynamo graph ColumnSchedules_to_Excel_V1_script.dyn (Dynamo 2.12.1.8246)
# packages: Data-Shapes 2024.2.113, bimorphNodes 5.1.3

# group: Input 1 - Spreadsheet File Path
string = StringInput("Section 1: Spreadsheet File Path")
select_the_spreadsheet_where_to = Filename("..\#Arup\Projects\50FernChurchStreet\Column data_Rev02_stripped.xlsx")  # "Select the spreadsheet where to export or save the data"; graph input
# note: File Path Node
pecc_spreadsheet_file_path = StringInput("Browse for Power BI Data Sheet file location before running this script")
filepath_data = Custom[FilePath Data](DefaulPath=select_the_spreadsheet_where_to, ButtonText=pecc_spreadsheet_file_path)  # package Data-Shapes; Create filepath input for UI.MultipleInputForm ++ . Check out www.data-shapes.net for more infos !
string_2 = StringInput("Note that this script will export the  data from this Revit model to the specified Excel spreadsheet above.")
textbox_data = Custom[TextBox Data](DefaultText=string_2)  # package Data-Shapes; Create Data for TextBox input in UI.MultipleInputForm ++ . Check out www.data-shapes.net for more informations

textbox_data_2 = Custom[TextBox Data](DefaultText=select_the_spreadsheet_where_to)

# group (continued): Input 1 - Spreadsheet File Path
list_create = List.Create(item0=filepath_data, item1=textbox_data_2, item2=textbox_data)
inputgroup_data = Custom[InputGroup Data](GroupTitle=string, Inputs=list_create)  # package Data-Shapes; Creates a group of inputs for UI.MultipleInputForm ++ . Check out www.data-shapes.net for more infos !

# group: Input 2 - Select Revit Schedule to Export
string_3 = StringInput("Section 2: Select Revit Schedule to export")
string_4 = StringInput("Next section is where you'll select the Revit schedule to export.")
textbox_data_3 = Custom[TextBox Data](DefaultText=string_4)
string_5 = StringInput("Revit Schedule")
element_types = ElementTypes("ViewSchedule")
all_elements_of_type = ElementsOfType(element_type=element_types)
name = Element.Name(element=all_elements_of_type)

dropdown_data = Custom[DropDown Data](InputName=string_5, Keys=name, Values=all_elements_of_type)  # package Data-Shapes; Create data for DropDown input in UI.MultiInputForm ++ . Check out www.data-shapes.net for more infos.

# group (continued): Input 2 - Select Revit Schedule to Export
list_create_2 = List.Create(item0=textbox_data_3, item1=dropdown_data)
inputgroup_data_2 = Custom[InputGroup Data](GroupTitle=string_3, Inputs=list_create_2)

# group: Input 3 - Spreadsheet Details
string_6 = StringInput("Section 3: About the spreadsheet")
string_7 = StringInput("Next section is to where to add the data in spreadsheet")
textbox_data_4 = Custom[TextBox Data](DefaultText=string_7)
string_8 = StringInput("What's the spreadsheet tab name where you want to export/save the data?")
textbox_data_5 = Custom[TextBox Data](DefaultText=string_8)
string_9 = StringInput("Tab Name")
string_10 = StringInput("L00")
textbox_data_6 = Custom[TextBox Data](InputName=string_9, DefaultText=string_10)
string_11 = StringInput("Last empty row number in the selected spreadsheet above")
textbox_data_7 = Custom[TextBox Data](DefaultText=string_11)
string_12 = StringInput("Row Number")
string_13 = StringInput("1")
boolean = BoolSelector(true)
textbox_data_8 = Custom[TextBox Data](InputName=string_12, DefaultText=string_13, IsNumberEntry=boolean)
string_14 = StringInput("Column number where you want the data to start writing. Counting starts from 0, i.e. Column A = 0.")
textbox_data_9 = Custom[TextBox Data](DefaultText=string_14)
string_15 = StringInput("Column Number")
string_16 = StringInput("8")
textbox_data_10 = Custom[TextBox Data](InputName=string_15, DefaultText=string_16, IsNumberEntry=boolean)
list_create_3 = List.Create(item0=textbox_data_4, item1=textbox_data_5, item2=textbox_data_6, item3=textbox_data_7, item4=textbox_data_8, item5=textbox_data_9, item6=textbox_data_10)
inputgroup_data_3 = Custom[InputGroup Data](GroupTitle=string_6, Inputs=list_create_3)

string_17 = StringInput("FINAL NOTE: MAKE SURE THAT THE SPREADSHEET ABOVE IS CLOSED FOR THIS SCRIPT TO RUN.")
textbox_data_11 = Custom[TextBox Data](DefaultText=string_17)
list_create_4 = List.Create(item0=inputgroup_data, item1=inputgroup_data_2, item2=inputgroup_data_3, item3=textbox_data_11)

# group: Master UI
string_18 = StringInput("Export Revit Schedule to Spreadsheet")
file_path = Filename("#AC_DynamoFiles\Logo.png")
file_from_path = FileObject(path=file_path)
readFromFile = Image.ReadFromFile(file=file_from_path)
string_19 = StringInput("Click here to continue")
boolean_2 = BoolSelector(true)
string_20 = StringInput("Cancel")
pop_up_window_size = CodeBlock { 1200; 300; }
multipleinputform = Custom[MultipleInputForm ++](Description_optional=string_18, Logo_optional=readFromFile, ButtonText_optional=string_19, Inputs=list_create_4, Toggle=boolean_2, CancelButtonText_optional=string_20, MaxHeight_optional=pop_up_window_size.out0, Width_optional=pop_up_window_size.out0, LabelWidth_optional=pop_up_window_size.out1)  # package Data-Shapes; Create a form with multiple inputs. see www.data-shapes.net for tutorials and infos!
watch = Watch(multipleinputform.User_Inputs)

code_block = CodeBlock { 0; 1; 2; 3; 4; 5; 6; 7; 8; 9; 10; 11; }
spreadsheet_file_path = List.GetItemAtIndex(list=watch, index=code_block.out0)
spreadsheet_sheet_tab_name = List.GetItemAtIndex(list=watch, index=code_block.out7)
start_row = List.GetItemAtIndex(list=watch, index=code_block.out9)
number = DoubleInput(1)
sub = start_row - number
start_column = List.GetItemAtIndex(list=watch, index=code_block.out11)
schedule_view_name = List.GetItemAtIndex(list=watch, index=code_block.out4)
getData = Revit.Schedule.GetData(scheduleView=schedule_view_name)
watch_2 = Watch(getData)
boolean_3 = BoolSelector(false)
exportToExcel = Data.ExportToExcel(filePath=spreadsheet_file_path, sheetName=spreadsheet_sheet_tab_name, startRow=sub, startColumn=start_column, data=watch_2, overWrite=boolean_3)
