# Dynamo graph CreateBeamPenetrations_V1_script.dyn (Dynamo 2.12.1.8246)
# packages: SteamNodes 1.2.4, Clockwork for Dynamo 2.x 2.3.0, Data-Shapes 2024.2.113

size = CodeBlock { 100; 400; }

# group: Inputs
string = StringInput("Element to be cut")
categories = Categories("OST_StructuralFraming")
list_create = List.Create(item0=categories)
all_elements_of_category = ElementsOfCategory(Category=list_create)
listview_data = Custom[Listview Data](InputName=string, Keys=list_create, Values=all_elements_of_category, Height_optionnal=size.out0)  # package Data-Shapes; Create data for ListView input in UI.MultiInputForm ++ . Check out www.data-shapes.net for more infos.
string_2 = StringInput("Cutting element")
categories_2 = Categories("OST_GenericModel")
list_create_2 = List.Create(item0=categories_2)
all_elements_of_category_2 = ElementsOfCategory(Category=list_create_2)
listview_data_2 = Custom[Listview Data](InputName=string_2, Keys=list_create_2, Values=all_elements_of_category_2, Height_optionnal=size.out0)
string_3 = StringInput("Select the Level")
categories_3 = Categories("OST_Levels")
all_elements_of_category_3 = ElementsOfCategory(Category=categories_3)
list_create_3 = List.Create(item0=all_elements_of_category_3)
flatten = List.Flatten(list=list_create_3)
code_block = CodeBlock(e=flatten) { e.Name; }
dropdown_data = Custom[DropDown Data](InputName=string_3, Keys=code_block, Values=code_block)  # package Data-Shapes; Create data for DropDown input in UI.MultiInputForm ++ . Check out www.data-shapes.net for more infos.
list_create_4 = List.Create(item0=listview_data, item1=listview_data_2, item2=dropdown_data)

# group: Master UI
string_4 = StringInput("Automating Cut Geometry on Framing Elements")
file_path = Filename(".\icon.PNG")
file_from_path = FileObject(path=file_path)
readFromFile = Image.ReadFromFile(file=file_from_path)
string_5 = StringInput("Click here to continue")
boolean = BoolSelector(true)
string_6 = StringInput("Cancel")
size_2 = CodeBlock { 700; 400; }
multipleinputform = Custom[MultipleInputForm ++](Description_optional=string_4, Logo_optional=readFromFile, ButtonText_optional=string_5, Inputs=list_create_4, Toggle=boolean, CancelButtonText_optional=string_6, MaxHeight_optional=size_2.out0, Width_optional=size_2.out0, LabelWidth_optional=size_2.out1)  # package Data-Shapes; Create a form with multiple inputs. see www.data-shapes.net for tutorials and infos!
watch = Watch(multipleinputform.User_Inputs)
code_block_2 = CodeBlock { 0; 1; 2; }

# group: Processing
element_to_be_cut_list = List.GetItemAtIndex(list=watch, index=code_block_2.out0)
flatten_2 = List.Flatten(list=element_to_be_cut_list)
boolean_2 = BoolSelector(false)
clean = List.Clean(list=flatten_2, preserveIndices=boolean_2)
flatten_3 = List.Flatten(list=clean)
code_block_3 = CodeBlock { "Reference Level"; }
getParameterValueByName = Element.GetParameterValueByName(element=flatten_3, parameterName=code_block_3)
code_block_4 = CodeBlock(e=getParameterValueByName) { e.Name; }
working_level = List.GetItemAtIndex(list=watch, index=code_block_2.out2)
contains = String.Contains(string=code_block_4, searchFor=working_level)
filterByBoolMask = List.FilterByBoolMask(list=flatten_3, mask=contains)
cutting_element_list = List.GetItemAtIndex(list=watch, index=code_block_2.out1)
flatten_4 = List.Flatten(list=cutting_element_list)
boolean_3 = BoolSelector(false)
clean_2 = List.Clean(list=flatten_4, preserveIndices=boolean_3)
flatten_5 = List.Flatten(list=clean_2)
code_block_5 = CodeBlock { "Work Plane"; }
getParameterValueByName_2 = Element.GetParameterValueByName(element=flatten_5, parameterName=code_block_5)
contains_2 = String.Contains(string=getParameterValueByName_2, searchFor=working_level)
filterByBoolMask_2 = List.FilterByBoolMask(list=flatten_5, mask=contains_2)
count = List.Count(list=filterByBoolMask.in)
count_2 = List.Count(list=filterByBoolMask_2.in)

# group: Output
code_block_6 = CodeBlock { 0; }
# note: STEAM NODES
getSurroundingElements = Custom[Tool.GetSurroundingElements](Element=filterByBoolMask.in, ElementCheck=filterByBoolMask_2.in, Tolerance=code_block_6)  # package SteamNodes; Get Surrounding Elements by Categories, group them as List. Tolerance distance available.
addVoidCut = Custom[Tool.AddVoidCut](ListOfList=getSurroundingElements)  # package SteamNodes; Add void cut for a Set of elements. In combination with Get surrounding elements node.
# note: CLOCKWORK
cutGeometry = Custom[Element.CutGeometry](elementToBeCut=filterByBoolMask.in, cuttingElement=filterByBoolMask_2.in, lacing=Longest)  # package Clockwork for Dynamo 2.x; Adds a solid-solid cut for two model elements (if possible).
