# Dynamo graph UpdateColumnTypeFromExcel_script.dyn (Dynamo 2.12.1.8246)
# packages: Rhythm 2023.9.1, Data-Shapes 2024.2.113

# group: Input 1 - Read from excel the new member sizes
string = StringInput("Section 1: Spreadsheet File Path")
select_the_spreadsheet_where_to = Filename("..\#Arup\Projects\50FernChurchStreet\Column data_Rev02_stripped.xlsx")  # "Select the spreadsheet where to export or save the data"; graph input
# note: File Path Node
new_column_sizes_excel = StringInput("Browse for the new column sizes excel spreadsheet file location before running this script")  # "New Column Sizes Excel Spreadsheet"
filepath_data = Custom[FilePath Data](DefaulPath=select_the_spreadsheet_where_to, ButtonText=new_column_sizes_excel)  # package Data-Shapes; Create filepath input for UI.MultipleInputForm ++ . Check out www.data-shapes.net for more infos !
textbox_data = Custom[TextBox Data](DefaultText=select_the_spreadsheet_where_to)  # package Data-Shapes; Create Data for TextBox input in UI.MultipleInputForm ++ . Check out www.data-shapes.net for more informations
string_2 = StringInput("Note that this script will update the column types in the Revit model.")
textbox_data_2 = Custom[TextBox Data](DefaultText=string_2)
string_3 = StringInput("Specify the column level you'll be updating")
textbox_data_3 = Custom[TextBox Data](DefaultText=string_3)
string_4 = StringInput("Spreadsheet Tab Name")
string_5 = StringInput("L00")
textbox_data_4 = Custom[TextBox Data](InputName=string_4, DefaultText=string_5)
list_create = List.Create(item0=filepath_data, item1=textbox_data, item2=textbox_data_2, item3=textbox_data_3, item4=textbox_data_4)
inputgroup_data = Custom[InputGroup Data](GroupTitle=string, Inputs=list_create)  # package Data-Shapes; Creates a group of inputs for UI.MultipleInputForm ++ . Check out www.data-shapes.net for more infos !

# group: Input 2 - Level information from Revit
string_6 = StringInput("Section 2: Column Base Level Information")
string_7 = StringInput("Column Base Level")
string_8 = StringInput("Ground Level")
textbox_data_5 = Custom[TextBox Data](InputName=string_7, DefaultText=string_8)
list_create_2 = List.Create(item0=textbox_data_5)
inputgroup_data_2 = Custom[InputGroup Data](GroupTitle=string_6, Inputs=list_create_2)

string_9 = StringInput("Select Revit Model Elements")
string_10 = StringInput("Click here to start picking elements")
boolean = BoolSelector(false)
selectmodelelements_data = Custom[SelectModelElements Data](InputName=string_9, ButtonText=string_10, SelectSingleElement=boolean)  # package Data-Shapes; Creates a Revit element selection input for UI.MultipleInputForm++ . Check out www.data-shapes.net for more infos!
list_create_3 = List.Create(item0=inputgroup_data, item1=inputgroup_data_2, item2=selectmodelelements_data)

# group: Master UI
string_11 = StringInput("Update Column Type from Spreadsheet")
file_path = Filename("#AC_DynamoFiles\Logo.png")
file_from_path = FileObject(path=file_path)
readFromFile = Image.ReadFromFile(file=file_from_path)
string_12 = StringInput("Click here to continue")
boolean_2 = BoolSelector(true)
string_13 = StringInput("Cancel")
steel_density_in_kg_m3 = CodeBlock { 1000; 400; }
multipleinputform = Custom[MultipleInputForm ++](Description_optional=string_11, Logo_optional=readFromFile, ButtonText_optional=string_12, Inputs=list_create_3, Toggle=boolean_2, CancelButtonText_optional=string_13, MaxHeight_optional=steel_density_in_kg_m3.out0, Width_optional=steel_density_in_kg_m3.out0, LabelWidth_optional=steel_density_in_kg_m3.out1)  # package Data-Shapes; Create a form with multiple inputs. see www.data-shapes.net for tutorials and infos!
watch = Watch(multipleinputform.User_Inputs)

code_block = CodeBlock { 0; 1; 2; 3; 4; 5; 6; 7; 8; 9; 10; 11; 12; 13; 14; }
selected_model_elements = List.GetItemAtIndex(list=watch, index=code_block.out6)
column_base_level = List.GetItemAtIndex(list=watch, index=code_block.out5)

# group: Collecting data (Revit ID, Type and Level) from a given category
code_block_2 = CodeBlock { "Base Level"; }
getParameterValueByName = Element.GetParameterValueByName(element=selected_model_elements, parameterName=code_block_2)
name = Level.Name(level=getParameterValueByName)
contains = String.Contains(string=name, searchFor=column_base_level)
filterByBoolMask = List.FilterByBoolMask(list=selected_model_elements, mask=contains)
list_create_4 = List.Create(item0=filterByBoolMask.in)
flatten = List.Flatten(list=list_create_4)
code_block_3 = CodeBlock(p=flatten) { p.Id; }
watch_2 = Watch(code_block_3)
code_block_4 = CodeBlock { "Type"; }
getParameterValueByName_2 = Element.GetParameterValueByName(element=flatten, parameterName=code_block_4)
code_block_5 = CodeBlock { "Base Level"; }
getParameterValueByName_3 = Element.GetParameterValueByName(element=flatten, parameterName=code_block_5)
name_2 = Family.Name(family=getParameterValueByName_3)

name_3 = FamilyType.Name(familyType=getParameterValueByName_2)

# group (continued): Collecting data (Revit ID, Type and Level) from a given category
list_create_5 = List.Create(item0=watch_2, item1=name_3, item2=name_2)
transpose = List.Transpose(lists=list_create_5)

spreadsheet_file_path = List.GetItemAtIndex(list=watch, index=code_block.out0)
spreadsheet_sheet_tab_name = List.GetItemAtIndex(list=watch, index=code_block.out4)

# group: Read from excel the new member sizes
file_from_path_2 = FileObject(path=spreadsheet_file_path)
importExcel = Data.ImportExcel(file=file_from_path_2, sheetName=spreadsheet_sheet_tab_name)
removeItemAtIndex = List.RemoveItemAtIndex(list=importExcel, indices=code_block.out0)
list_create_6 = List.Create(item0=removeItemAtIndex)
transpose_2 = List.Transpose(lists=list_create_6@L3)
getItemAtIndex = List.GetItemAtIndex(list=transpose_2@L3, index=code_block.out8)
getItemAtIndex_2 = List.GetItemAtIndex(list=transpose_2@L3, index=code_block.out5)
getItemAtIndex_3 = List.GetItemAtIndex(list=transpose_2@L3, index=code_block.out14)
list_create_7 = List.Create(item0=getItemAtIndex, item1=getItemAtIndex_2, item2=getItemAtIndex_3)
transpose_3 = List.Transpose(lists=list_create_7)
# note: Revit ID
getItemAtIndex_4 = List.GetItemAtIndex(list=getItemAtIndex@L1, index=code_block.out0)
# note: Column Type
getItemAtIndex_5 = List.GetItemAtIndex(list=getItemAtIndex_2@L1, index=code_block.out0)
# note: Level Ref
getItemAtIndex_6 = List.GetItemAtIndex(list=getItemAtIndex_3@L1, index=code_block.out0)

# note: Revit ID Check
eq = watch_2 == getItemAtIndex_4
# note: Member Size Check
eq_2 = name_3 == getItemAtIndex_5
code_block_6 = CodeBlock { "Type"; }
# note: Sizes currently in the model
name_4 = FamilyType.Name(familyType=getParameterValueByName_2)
# note: New sizes from excel spreadsheet
getItemAtIndex_7 = List.GetItemAtIndex(list=getItemAtIndex_2@L1, index=code_block.out0)
eq_3 = _ == _  # unwired: x, y
replaceByCondition = Replace(item=name_4, replaceWith=getItemAtIndex_7, condition=eq_3)
byName = FamilyType.ByName(name=replaceByCondition)
ʳʰʸᵗʰᵐ_elements = Rhythm.Revit.Elements.Elements.SetParameterByNameTypeOrInstance(element=selected_model_elements, parameterName=code_block_6, value=byName)
contains_2 = List.Contains(list=getItemAtIndex_6, item=column_base_level)
# note: Level Check
eq_4 = name_2 == contains_2
getItemAtIndex_8 = List.GetItemAtIndex(list=transpose_2@L3, index=code_block.out6)
# note: Level Ref
getItemAtIndex_9 = List.GetItemAtIndex(list=getItemAtIndex_8@L1, index=code_block.out0)
flatten_2 = List.Flatten(list=getItemAtIndex_9)

# group: Set Level Parameter - Output
code_block_7 = CodeBlock { "Specification_Material_Strength Grade"; }
setParameterByName = Element.SetParameterByName(element=selected_model_elements, parameterName=code_block_7, value=flatten_2)
getParameterValueByName_4 = Element.GetParameterValueByName(element=setParameterByName, parameterName=code_block_7)
