# Dynamo graph Wall_Surface_Area_by_Room_V1.dyn (Dynamo 2.12.1.8246)
# packages: Modelical 2022.6.15, Data-Shapes 2024.2.113

# group: Input
string = StringInput("Select the Revit Categories")
categories = Categories("OST_Rooms")
list_create = List.Create(item0=categories)
all_elements_of_category = ElementsOfCategory(Category=list_create)
listview_data = Custom[Listview Data](InputName=string, Keys=list_create, Values=all_elements_of_category)  # package Data-Shapes; Create data for ListView input in UI.MultiInputForm ++ . Check out www.data-shapes.net for more infos.
string_2 = StringInput("Wall Finish Parameter Name")
string_3 = StringInput("Asset_Wall_Finish")
textbox_data = Custom[TextBox Data](InputName=string_2, DefaultText=string_3)  # package Data-Shapes; Create Data for TextBox input in UI.MultipleInputForm ++ . Check out www.data-shapes.net for more informations
string_4 = StringInput("Ceiling Height Parameter Name")
string_5 = StringInput("Ceiling Height")
textbox_data_2 = Custom[TextBox Data](InputName=string_4, DefaultText=string_5)
list_create_2 = List.Create(item0=listview_data, item1=textbox_data, item2=textbox_data_2)

# group: Master UI
string_6 = StringInput("Create Worksets from an Excel spreadsheet")
file_path = Filename(".\Logo.png")
file_from_path = FileObject(path=file_path)
readFromFile = Image.ReadFromFile(file=file_from_path)
string_7 = StringInput("Click here to continue")
boolean = BoolSelector(true)
string_8 = StringInput("Cancel")
steel_density_in_kg_m3 = CodeBlock { 800; 400; }
multipleinputform = Custom[MultipleInputForm ++](Description_optional=string_6, Logo_optional=readFromFile, ButtonText_optional=string_7, Inputs=list_create_2, Toggle=boolean, CancelButtonText_optional=string_8, MaxHeight_optional=steel_density_in_kg_m3.out0, Width_optional=steel_density_in_kg_m3.out0, LabelWidth_optional=steel_density_in_kg_m3.out1)  # package Data-Shapes; Create a form with multiple inputs. see www.data-shapes.net for tutorials and infos!
watch = Watch(multipleinputform.User_Inputs)
code_block = CodeBlock { 0; 1; 2; }

getItemAtIndex = List.GetItemAtIndex(list=watch, index=code_block.out0)
getItemAtIndex_2 = List.GetItemAtIndex(list=watch, index=code_block.out1)
getItemAtIndex_3 = List.GetItemAtIndex(list=watch, index=code_block.out2)

# group: Output
# note: Package: Modelical
wallFinishesByRoom = Custom[Wall.WallFinishesByRoom](rooms=getItemAtIndex, wallFinishesParam=getItemAtIndex_2, finishesHeightParam=getItemAtIndex_3)  # frozen; package Modelical; This node places room wall finishes using the info contained in the parameters (selected by name) where is defined the wall finishes type and the finishes height.
